# Grasshopper definition all.gh (Grasshopper 1.0.8)

file = ReadFile(File="G:\マイドライブ\研究\変更分析\BIM\Grasshopper\scripts_gh\pier\const_column.py", PerLineParse=False)
file_2 = ReadFile(File="G:\マイドライブ\研究\変更分析\BIM\Grasshopper\scripts_gh\bake.py", PerLineParse=False)
py3 = Python3Script(script=file)  # -> out, bake_dict; unedited script template
py3_2 = Python3Script(script=file_2)  # -> out, a; unedited script template
panel = Panel(py3.out)
